# Grasshopper definition create_pattern_input.gh (Grasshopper 1.0.7)

# Pattern 1
crv = Curve(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)
# Pattern 2
number_slider = Slider(59.5, range=0..100)
number_slider_2 = Slider(59.5, range=0..100)
number_slider_3 = Slider(59.5, range=0..100)
vec = VectorXYZ(XComponent=Slider(0.12, range=0..1), YComponent=Slider(0.18, range=0..1), ZComponent=0)  # -> Vector, Length
long_curve_1 = Curve(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)
long_curve_2 = Curve(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)
long_curve_2_2 = Curve(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)
number_slider_4 = Slider(152, range=0..1000)
multiplication = Multiplication(A=vec.Vector, B=Slider(276, range=0..1000))
ext = ExtendCurve(Curve=long_curve_1, Type=0, Start=expr("-x", number_slider), End=expr("-x", number_slider))
ext_2 = ExtendCurve(Curve=long_curve_2, Type=0, Start=expr("-x", number_slider_2), End=expr("-x", number_slider_2))
ext_3 = ExtendCurve(Curve=long_curve_2_2, Type=0, Start=expr("-x", number_slider_3), End=expr("-x", number_slider_3))
number_slider_5 = Slider(1.131, range=0..10)
move = Move(Geometry=crv, Motion=multiplication)  # -> Geometry, Transform
midpt = CurveMiddle(Curve=move.Geometry)
number_slider_6 = Slider(25, range=0..100)
scale = Scale(Geometry=move.Geometry, Center=midpt, Factor=number_slider_5)  # -> Geometry, Transform
move_2 = Move(Geometry=scale.Geometry, Motion=multiplication)  # -> Geometry, Transform
midpt_2 = CurveMiddle(Curve=move_2.Geometry)
scale_2 = Scale(Geometry=move_2.Geometry, Center=midpt_2, Factor=number_slider_5)  # -> Geometry, Transform
move_3 = Move(Geometry=scale_2.Geometry, Motion=multiplication)  # -> Geometry, Transform
divide = DivideCurve(Curve=ext, Count=Slider(18, range=0..100), Kinks=False)  # -> Points, Tangents, Parameters
divide_2 = DivideCurve(Curve=ext_2, Count=Slider(13, range=0..100), Kinks=False)  # -> Points, Tangents, Parameters
divide_3 = DivideCurve(Curve=ext_3, Count=Slider(13, range=0..100), Kinks=False)  # -> Points, Tangents, Parameters
midpt_3 = CurveMiddle(Curve=move_3.Geometry)
eval = EvaluateCurve(Curve=ext, Parameter=divide.Parameters)  # -> Point, Tangent, Angle

# ---- group: length variation
number_slider_7 = Slider(50, range=0..100)
number_slider_8 = Slider(212, range=0..1000)
index = ItemIndex(List=eval.Point, Item=eval.Point)
bnd = Bounds(Numbers=index)
dom = ConstructDomain(DomainStart=number_slider_8, DomainEnd=number_slider_7)
remap = RemapNumbers(Value=index, Source=bnd, Target=dom)  # -> Mapped, Clipped

# ----
eval_2 = EvaluateCurve(Curve=ext_2, Parameter=divide_2.Parameters)  # -> Point, Tangent, Angle
eval_3 = EvaluateCurve(Curve=ext_3, Parameter=divide_3.Parameters)  # -> Point, Tangent, Angle
scale_3 = Scale(Geometry=move_3.Geometry, Center=midpt_3, Factor=number_slider_5)  # -> Geometry, Transform
move_4 = Move(Geometry=scale_3.Geometry, Motion=multiplication)  # -> Geometry, Transform
midpt_4 = CurveMiddle(Curve=move_4.Geometry)

# ---- group: height variation
number_slider_9 = Slider(8, range=0..100)
number_slider_10 = Slider(65, range=0..1000)
index_2 = ItemIndex(List=eval.Point, Item=eval.Point)
bnd_2 = Bounds(Numbers=index_2)
dom_2 = ConstructDomain(DomainStart=number_slider_10, DomainEnd=number_slider_9)
remap_2 = RemapNumbers(Value=index_2, Source=bnd_2, Target=dom_2)  # -> Mapped, Clipped

# ---- group: length variation
index_3 = ItemIndex(List=eval_2.Point, Item=eval_2.Point)
bnd_3 = Bounds(Numbers=index_3)
dom_3 = ConstructDomain(DomainStart=number_slider_8, DomainEnd=number_slider_7)
remap_3 = RemapNumbers(Value=index_3, Source=bnd_3, Target=dom_3)  # -> Mapped, Clipped

index_4 = ItemIndex(List=eval_3.Point, Item=eval_3.Point)
bnd_4 = Bounds(Numbers=index_4)
dom_4 = ConstructDomain(DomainStart=number_slider_8, DomainEnd=number_slider_7)
remap_4 = RemapNumbers(Value=index_4, Source=bnd_4, Target=dom_4)  # -> Mapped, Clipped

# ---- group: height variation
index_5 = ItemIndex(List=eval_3.Point, Item=eval_3.Point)
bnd_5 = Bounds(Numbers=index_5)
dom_5 = ConstructDomain(DomainStart=Slider(100, range=0..1000), DomainEnd=Slider(15, range=0..100))
remap_5 = RemapNumbers(Value=index_5, Source=bnd_5, Target=dom_5)  # -> Mapped, Clipped

# ----
scale_4 = Scale(Geometry=move_4.Geometry, Center=midpt_4, Factor=number_slider_5)  # -> Geometry, Transform
rotate = Rotate(Geometry=eval.Tangent, Angle=degrees(Slider(26, range=0..100)), Plane=PlaneXY(0, 0, 0))  # -> Geometry, Transform
rotate_2 = Rotate(Geometry=eval_2.Tangent, Angle=degrees(Slider(26, range=0..100)), Plane=PlaneXY(0, 0, 0))  # -> Geometry, Transform
rotate_3 = Rotate(Geometry=eval_3.Tangent, Angle=degrees(Slider(26, range=0..100)), Plane=PlaneXY(0, 0, 0))  # -> Geometry, Transform
divide_4 = DivideCurve(Curve=long_curve_1, Count=Slider(25, range=0..100), Kinks=False)  # -> Points, Tangents, Parameters

# ---- group: height variation
index_6 = ItemIndex(List=eval_2.Point, Item=eval_2.Point)
bnd_6 = Bounds(Numbers=index_6)
dom_6 = ConstructDomain(DomainStart=number_slider_10, DomainEnd=number_slider_9)
remap_6 = RemapNumbers(Value=index_6, Source=bnd_6, Target=dom_6)  # -> Mapped, Clipped

# ----
height = Number(number_slider_4)
divide_5 = DivideCurve(Curve=long_curve_2, Count=Slider(25, range=0..100), Kinks=False)  # -> Points, Tangents, Parameters
height_2 = Number(number_slider_4)
divide_6 = DivideCurve(Curve=long_curve_2_2, Count=Slider(25, range=0..100), Kinks=False)  # -> Points, Tangents, Parameters
line = LineSDL(Start=eval.Point, Direction=rotate.Geometry, Length=remap.Mapped)
height_3 = Number(number_slider_4)
line_2 = LineSDL(Start=eval_2.Point, Direction=rotate_2.Geometry, Length=remap_3.Mapped)
line_3 = LineSDL(Start=eval_3.Point, Direction=rotate_3.Geometry, Length=remap_4.Mapped)
divide_7 = DivideCurve(Curve=scale_4.Geometry, Count=number_slider_6, Kinks=False)  # -> Points, Tangents, Parameters
Z = UnitZ(Factor=height)
divide_8 = DivideCurve(Curve=scale_2.Geometry, Count=number_slider_6, Kinks=False)  # -> Points, Tangents, Parameters
Z_2 = UnitZ(Factor=height_2)
divide_9 = DivideCurve(Curve=scale_3.Geometry, Count=number_slider_6, Kinks=False)  # -> Points, Tangents, Parameters
divide_10 = DivideCurve(Curve=crv, Count=number_slider_6, Kinks=False)  # -> Points, Tangents, Parameters
divide_11 = DivideCurve(Curve=scale.Geometry, Count=number_slider_6, Kinks=False)  # -> Points, Tangents, Parameters
Z_3 = UnitZ(Factor=height_3)
midpt_5 = CurveMiddle(Curve=line)
end = EndPoints(Curve=line)  # -> Start, End
midpt_6 = CurveMiddle(Curve=line_2)
end_2 = EndPoints(Curve=line_2)  # -> Start, End
midpt_7 = CurveMiddle(Curve=line_3)
end_3 = EndPoints(Curve=line_3)  # -> Start, End
lng = ListLength(List=divide_7.Points)
move_5 = Move(Geometry=divide_4.Points, Motion=Z)  # -> Geometry, Transform
lng_2 = ListLength(List=divide_8.Points)
move_6 = Move(Geometry=divide_5.Points, Motion=Z_2)  # -> Geometry, Transform
lng_3 = ListLength(List=divide_9.Points)
lng_4 = ListLength(List=divide_10.Points)
lng_5 = ListLength(List=divide_11.Points)
move_7 = Move(Geometry=divide_6.Points, Motion=Z_3)  # -> Geometry, Transform
vec2pt = Vector2Pt(PointA=midpt_5, PointB=end.Start, Unitize=False)  # -> Vector, Length
vec2pt_2 = Vector2Pt(PointA=midpt_6, PointB=end_2.Start, Unitize=False)  # -> Vector, Length
vec2pt_3 = Vector2Pt(PointA=midpt_7, PointB=end_3.Start, Unitize=False)  # -> Vector, Length
height_4 = Number(remap_2.Mapped)
range = Range(Domain=Domain(0, 1), Steps=lng)
height_5 = Number(remap_6.Mapped)
range_2 = Range(Domain=Domain(0, 1), Steps=lng_2)
height_6 = Number(remap_5.Mapped)
range_3 = Range(Domain=Domain(0, 1), Steps=lng_3)
range_4 = Range(Domain=Domain(0, 1), Steps=lng_4)
range_5 = Range(Domain=Domain(0, 1), Steps=lng_5)
Z_4 = UnitZ(Factor=height_4)
Z_5 = UnitZ(Factor=height_5)
Z_6 = UnitZ(Factor=height_6)

# ---- group: Parabola params
number_slider_11 = Slider(100, range=0..120)
number_slider_12 = Slider(15, range=0..20)

# ----
addition = Addition(A=vec2pt.Vector, B=Z_4)
graph = GraphMapper(
    range_2,
    x0=0,
    x1=1,
    y0=0,
    y1=1,
    Ox=0.5094326138,
    Oy=0.01253253222,
    Px=0.7826620936,
    Py=0.2911996245,
    container_name="Parabola")
graph_2 = GraphMapper(
    range_3,
    x0=0,
    x1=1,
    y0=0,
    y1=1,
    Ox=0.5094326138,
    Oy=0.01253253222,
    Px=0.7826620936,
    Py=0.2911996245,
    container_name="Parabola")
graph_3 = GraphMapper(
    range,
    x0=0,
    x1=1,
    y0=0,
    y1=1,
    Ox=0.5094326138,
    Oy=0.01253253222,
    Px=0.7826620936,
    Py=0.2911996245,
    container_name="Parabola")
addition_2 = Addition(A=vec2pt_2.Vector, B=Z_5)
graph_4 = GraphMapper(
    range_4,
    x0=0,
    x1=1,
    y0=0,
    y1=1,
    Ox=0.5094326138,
    Oy=0.01253253222,
    Px=0.7826620936,
    Py=0.2911996245,
    container_name="Parabola")
graph_5 = GraphMapper(
    range_5,
    x0=0,
    x1=1,
    y0=0,
    y1=1,
    Ox=0.5094326138,
    Oy=0.01253253222,
    Px=0.7826620936,
    Py=0.2911996245,
    container_name="Parabola")
addition_3 = Addition(A=vec2pt_3.Vector, B=Z_6)
move_8 = Move(Geometry=line, Motion=addition)  # -> Geometry, Transform
move_9 = Move(Geometry=line_2, Motion=addition_2)  # -> Geometry, Transform
move_10 = Move(Geometry=line_3, Motion=addition_3)  # -> Geometry, Transform
end_4 = EndPoints(Curve=move_9.Geometry)  # -> Start, End
end_5 = EndPoints(Curve=move_10.Geometry)  # -> Start, End
multiplication_2 = Multiplication(A=graph_3, B=number_slider_11)
multiplication_3 = Multiplication(A=graph, B=number_slider_11)
multiplication_4 = Multiplication(A=graph_2, B=number_slider_11)
multiplication_5 = Multiplication(A=graph_4, B=number_slider_11)
multiplication_6 = Multiplication(A=graph_5, B=number_slider_11)
end_6 = EndPoints(Curve=move_8.Geometry)  # -> Start, End
weave = Weave(Pattern=[0, 1], Stream0=end_5.Start, Stream1=end_5.End, NullGaps=False)
weave_2 = Weave(Pattern=[0, 1], Stream0=end_4.Start, Stream1=end_4.End, NullGaps=False)
addition_4 = Addition(A=multiplication_2, B=number_slider_12)
addition_5 = Addition(A=multiplication_3, B=number_slider_12)
addition_6 = Addition(A=multiplication_4, B=number_slider_12)
weave_3 = Weave(Pattern=[0, 1], Stream0=end_6.Start, Stream1=end_6.End, NullGaps=False)
addition_7 = Addition(A=multiplication_5, B=number_slider_12)
addition_8 = Addition(A=multiplication_6, B=number_slider_12)
pt = Point(move_6.Geometry)
pt_2 = Point(weave_2)
Z_7 = UnitZ(Factor=addition_4)
pt_3 = Point(weave)
pt_4 = Point(move_7.Geometry)
Z_8 = UnitZ(Factor=addition_5)
Z_9 = UnitZ(Factor=addition_6)
Z_10 = UnitZ(Factor=addition_7)
Z_11 = UnitZ(Factor=addition_8)
pt_5 = Point(weave_3)
pt_6 = Point(move_5.Geometry)
move_11 = Move(Geometry=divide_7.Points, Motion=Z_7)  # -> Geometry, Transform
move_12 = Move(Geometry=divide_8.Points, Motion=Z_8)  # -> Geometry, Transform
move_13 = Move(Geometry=divide_9.Points, Motion=Z_9)  # -> Geometry, Transform
move_14 = Move(Geometry=divide_10.Points, Motion=Z_10)  # -> Geometry, Transform
move_15 = Move(Geometry=divide_11.Points, Motion=Z_11)  # -> Geometry, Transform

# ---- group: continuous extruder, constant color
ghpython_script = GhPythonScript(pts=pt_6, color=Slider(0, range=0..100))  # -> out, extruders, colors; inputs pts: list
# ---------- ghpython_script: Python ----------
__author__ = "Ioanna"
__version__ = "2021.08.17"

import rhinoscriptsyntax as rs

extruders = [True for _ in pts]
extruders[-1] = False

colors = [color for _ in pts]
# ---------- end ghpython_script ----------

ghpython_script_2 = GhPythonScript(pts=pt_4, color=Slider(1, range=0..100))  # -> out, extruders, colors; inputs pts: list; same code as ghpython_script

ghpython_script_3 = GhPythonScript(pts=pt, color=Slider(2, range=0..10))  # -> out, extruders, colors; inputs pts: list; same code as ghpython_script

# ---- group: line segments, random colors
ghpython_script_4 = GhPythonScript(pts=pt_5)  # -> out, extruders, colors; inputs pts: list
# ---------- ghpython_script_4: Python ----------
__author__ = "Ioanna"
__version__ = "2021.08.17"

import rhinoscriptsyntax as rs
import random



extruders = [i%2==0 for i, _ in enumerate(pts)]
extruders[-1] = False



colors = [random.randint(1, 3) for _ in pts]
# ---------- end ghpython_script_4 ----------

ghpython_script_5 = GhPythonScript(pts=pt_3)  # -> out, extruders, colors; inputs pts: list; same code as ghpython_script_4

ghpython_script_6 = GhPythonScript(pts=pt_2)  # -> out, extruders, colors; inputs pts: list; same code as ghpython_script_4

# ---- group: continuous
ghpython_script_7 = GhPythonScript(pts=move_14.Transform)  # -> out, extruders; inputs pts: list
# ---------- ghpython_script_7: Python ----------
__author__ = "Ioanna"
__version__ = "2021.08.17"

import rhinoscriptsyntax as rs

extruders = [True for _ in pts]
extruders[-1] = False
# ---------- end ghpython_script_7 ----------

python = GhPythonScript(pts=move_15.Geometry)  # -> out, extruders; inputs pts: list; same code as ghpython_script_7

python_2 = GhPythonScript(pts=move_12.Geometry)  # -> out, extruders; inputs pts: list; same code as ghpython_script_7

python_3 = GhPythonScript(pts=move_13.Geometry)  # -> out, extruders; inputs pts: list; same code as ghpython_script_7

python_4 = GhPythonScript(pts=move_11.Geometry)  # -> out, extruders; inputs pts: list; same code as ghpython_script_7

# ----
ghpython_script_8 = GhPythonScript(pts=move_14.Transform, color=Slider(1, range=0..100))  # -> out, colors; inputs pts: list
# ---------- ghpython_script_8: Python ----------
__author__ = "Ioanna"
__version__ = "2021.08.17"

import rhinoscriptsyntax as rs

colors = [color for _ in pts]
# ---------- end ghpython_script_8 ----------
ghpython_script_9 = GhPythonScript(pts=move_15.Geometry, color=Slider(2, range=0..100))  # -> out, colors; inputs pts: list; same code as ghpython_script_8
ghpython_script_10 = GhPythonScript(pts=move_12.Geometry, color=Slider(3, range=0..100))  # -> out, colors; inputs pts: list; same code as ghpython_script_8
ghpython_script_11 = GhPythonScript(pts=move_13.Geometry, color=Slider(2, range=0..100))  # -> out, colors; inputs pts: list
# ---------- ghpython_script_11: Python ----------
__author__ = "Ioanna"
__version__ = "2021.08.17"

import rhinoscriptsyntax as rs
colors = [color for _ in pts]
# ---------- end ghpython_script_11 ----------
ghpython_script_12 = GhPythonScript(pts=move_11.Geometry, color=Slider(1, range=0..100))  # -> out, colors; inputs pts: list; same code as ghpython_script_11

# ---- group: pts
merge = Merge(
    Data1=flatten(move_14.Geometry),
    Data2=flatten(move_15.Geometry),
    Data3=flatten(move_12.Geometry),
    Data4=flatten(move_13.Geometry),
    Data5=flatten(move_11.Geometry))

# ---- group: extruders
merge_2 = Merge(
    Data1=flatten(ghpython_script_7.extruders),
    Data2=flatten(python.extruders),
    Data3=flatten(python_2.extruders),
    Data4=flatten(python_3.extruders),
    Data5=flatten(python_4.extruders))

# ---- group: colors
merge_3 = Merge(
    Data1=flatten(ghpython_script_8.colors),
    Data2=flatten(ghpython_script_9.colors),
    Data3=flatten(ghpython_script_10.colors),
    Data4=flatten(ghpython_script_11.colors),
    Data5=flatten(ghpython_script_12.colors))

# ---- group: pts
merge_4 = Merge(
    Data1=flatten(pt_6),
    Data2=flatten(pt_5),
    Data3=flatten(pt_4),
    Data4=flatten(pt_3),
    Data5=flatten(pt),
    Data6=flatten(pt_2))

# ---- group: extruders
merge_5 = Merge(
    Data1=flatten(ghpython_script.extruders),
    Data2=flatten(ghpython_script_4.extruders),
    Data3=flatten(ghpython_script_2.extruders),
    Data4=flatten(ghpython_script_5.extruders),
    Data5=flatten(ghpython_script_3.extruders),
    Data6=flatten(ghpython_script_6.extruders))

# ---- group: colors
merge_6 = Merge(
    Data1=flatten(ghpython_script.colors),
    Data2=flatten(ghpython_script_4.colors),
    Data3=flatten(ghpython_script_2.colors),
    Data4=flatten(ghpython_script_5.colors),
    Data5=flatten(ghpython_script_3.colors),
    Data6=flatten(ghpython_script_6.colors))

# ----
cloud = CloudDisplay(Points=merge, Colours=ColourSwatch(SwatchColor=RGB(255, 0, 0)), Size=Slider(7.148, range=0..10), SpriteType=1)
cloud_2 = CloudDisplay(Points=merge_4, Colours=ColourSwatch(SwatchColor=RGB(255, 0, 0)), Size=Slider(7.148, range=0..10), SpriteType=1)

extruder_booleans = Data(merge_2)
points = Data(merge)
colors = Data(merge_3)

extruder_booleans_2 = Data(merge_5)
points_2 = Data(merge_4)
colors_2 = Data(merge_6)

extruder_booleans_3 = Data(extruder_booleans)
colors_3 = Data(colors)
points_3 = Data(points)

number_slider_13 = Slider(100, range=0..100)
py = PythonScript()  # -> path
# ---------- py: Python ----------
import sys
import os

ghComp = ghenv.Component
ghDoc = ghComp.OnPingDocument()

# the full path of the gh file
path = ghDoc.FilePath
# the current directory 
path = os.path.abspath(os.path.join(path, ".."))

print path
# ---------- end py ----------

# ----
# Save json input file
python_5 = GhPythonScript(
    pts=points_3,
    extruders=extruder_booleans_3,
    colors=colors_3,
    velocity=Slider(55, range=0..1000),
    save_json=Button(),
    path=py,
    json_name="input/pattern_2.json")  # -> out, script; inputs pts: list of Point3d, extruders: list of Boolean, colors: list of Int32
# ---------- python_5: Python ----------
__author__ = "Ioanna Mitropoulou"
__version__ = "2021.08.17"

import Rhino.Geometry as rg
import math
import os
import rhinoscriptsyntax as rs
import json

def save_to_json(data, filepath, name):
    filename = os.path.join(filepath, name)
    print("Saving to json: " + filename)
    with open(filename, 'w') as f:
        f.write(json.dumps(data, indent=3, sort_keys=True))

assert len(pts) == len(extruders)
assert len(colors) == len(extruders)

class PrintPoint:
    def __init__(self, pt, extruder, color, velocity):
        self.pt = pt
        self.extruder = extruder
        self.color = color
        self.v = velocity
    def to_data(self):
        data = {'pt': [self.pt.X, self.pt.Y, self.pt.Z],
                'extruder': self.extruder,
                'color': self.color,
                'v': self.v}
        return data
ppts = [PrintPoint(pt, extruder, color, velocity) for pt, extruder, color in zip(pts, extruders, colors)]
    
if save_json:
    data = {}
    for i, ppt in enumerate(ppts):
        data[i] = ppt.to_data()
    save_to_json(data, path, json_name)
# ---------- end python_5 ----------

panel = Panel(python_5.out)
